# Grasshopper definition e2e-canvas.gh (Grasshopper 1.0.8)
# plug-ins: SmartHopper.Components

boolean_toggle = BooleanToggle(True)
panel = Panel("{\"name\":\"pavilion\",\"floors\":3,\"area\":120.5}")
panel_2 = Panel("""alpha
bravo
charlie""")
toggle = BooleanToggle(True)
smarthopper_mcp_server = SmartHopperMCPServer(
    Enable=boolean_toggle,
    Port=26929,
    AllowEditing=boolean_toggle,
    BypassEditionValidation=boolean_toggle,
    AllowViewControl=boolean_toggle)  # -> Url, Status
ghget = GetGhJSON(
    ConnectionDepth=0,
    Count=100,
    IncludeMetadata=False,
    IncludeRuntimeData=False,
    ViewportOnly=False,
    Run=toggle,
    InputBranchCount_Attribute_Filter=1,
    InputBranchCount_Category_Filter=1,
    InputBranchCount_Connection_Depth=1,
    InputBranchCount_Include_Metadata=1,
    InputBranchCount_Include_Runtime_Data=1,
    InputBranchCount_Run=1,
    InputBranchCount_Type_filter=1,
    InputBranchCount_Viewport_Only=1,
    InputHash_Attribute_Filter=-1676863422,
    InputHash_Category_Filter=-1676863422,
    InputHash_Connection_Depth=1023377666,
    InputHash_Include_Metadata=-465060816,
    InputHash_Include_Runtime_Data=-465060816,
    InputHash_Run=-465060815,
    InputHash_Type_filter=-1676863422,
    InputHash_Viewport_Only=-465060816,
    PO_Version=2)  # -> Names, Guids, GhJSON
jsonsanitize = JSONSanitizer(JSON=panel, Minify=Toggle(True))  # -> JSON, Summary, IsObject, IsArray
jsonschemaprop = JSONSchemaProperty(Name="floors", Description="Number of floors", Type="integer", Array=False, Required=False)
jsonsetvalue = JSONSetValue(JSON=panel, Path="floors", Value="5")
jsonobject = JSONObject(Key="mykey", Value="myvalue")
jsongetvalue = JSONGetValue(JSON=panel, Path="floors")
json2text = JSONToText(JSON=panel, Pretty=Toggle(True))
jsonarray2text = JSONArrayToTextList(JSON="[1, 2, 3]")
jsonarray = JSONArray(Items=panel_2)
jsonschema = JSONSchema(Title="Building", Description="A building schema", Properties=jsonschemaprop, Array=False)
ghvalidate = ValidateGhJSON(GhJSON=ghget.GhJSON, Level=1, PreferOnline=False)  # -> Valid, Errors, Warnings, Info
saveghjson = SaveGhJSON(
    GhJSON=ghget.GhJSON,
    Path="C:/Temp/sh-test.ghjson",
    Run=toggle,
    InputBranchCount_GhJSON=1,
    InputBranchCount_Path=1,
    InputBranchCount_Run=1,
    InputHash_GhJSON=1259041725,
    InputHash_Path=1326210630,
    InputHash_Run=-465060815,
    PO_Version=2)
ghdiff = DiffGhJSON(Left=ghget.GhJSON, Right=ghget.GhJSON, Run=toggle)  # -> Patch, CompOps, ConnOps, GroupOps
openghjson = OpenGhJSON(
    Path=saveghjson,
    Run=toggle,
    InputBranchCount_Path=1,
    InputBranchCount_Run=1,
    InputHash_Path=1326210630,
    InputHash_Run=-465060815,
    PO_Version=2)  # -> GhJSON, Valid, Errors
settings = Settings(Batch=False)
aiprompt = AIPrompt(Prompt="Reply with exactly the word: PONG")
text2ai = TextToAI(Text="What is 2+2? Reply with the number only.")
toggle_2 = BooleanToggle(True)
extras = ExtraSettings(Reasoning_effort="none", AIProvider="Default")
ai_text = AIToText(
    Input=aiprompt,
    Settings=settings,
    Run=toggle_2,
    AIProvider="Default",
    InputBranchCount_Input=1,
    InputBranchCount_Run=1,
    InputBranchCount_Settings=1,
    InputHash_Input=-572779099,
    InputHash_Run=-465060815,
    InputHash_Settings=-747672519,
    PO_Version=2)  # -> Text, Metrics
ai_text_2 = AIToText(
    Input=text2ai,
    Run=Toggle(True),
    AIProvider="Default",
    InputBranchCount_Input=1,
    InputBranchCount_Run=1,
    InputBranchCount_Settings=0,
    InputHash_Input=793665101,
    InputHash_Run=-465060815,
    InputHash_Settings=0,
    PO_Version=2)  # -> Text, Metrics
aimodels = AIModels(Run=toggle_2, AIProvider="Default", InputBranchCount_Run=1, InputHash_Run=-465060815, PO_Version=2)
toggle_3 = BooleanToggle(True)
panel_3 = Panel("Reply with exactly three items separated by commas: apple, banana, cherry")
text2ai_2 = TextToAI(Text="Is water wet? Answer only true or false.")
text2ai_3 = TextToAI(Text="Reply only with the number 42.5")
text2ai_4 = TextToAI(Text="Reply only with the integer 7")
text2ai_5 = TextToAI(Text=panel_3)
text2ai_6 = TextToAI(Text="Reply only with the numbers 1, 2, 3")
text2ai_7 = TextToAI(Text="Reply only with the integers 4, 5, 6")
text2ai_8 = TextToAI(Text="Reply only with: true, false, true")
ai_bool = AIToBoolean(
    Input=text2ai_2,
    Run=toggle_3,
    AIProvider="Default",
    InputBranchCount_Fallback=0,
    InputBranchCount_Input=1,
    InputBranchCount_Run=1,
    InputBranchCount_Settings=0,
    InputHash_Fallback=0,
    InputHash_Input=-1385538187,
    InputHash_Run=-465060815,
    InputHash_Settings=0,
    PO_Version=2)  # -> Boolean, UsedFallback, Metrics
ai_num = AIToNumber(
    Input=text2ai_3,
    Run=toggle_3,
    AIProvider="Default",
    InputBranchCount_Fallback=0,
    InputBranchCount_Input=1,
    InputBranchCount_Run=1,
    InputBranchCount_Settings=0,
    InputHash_Fallback=0,
    InputHash_Input=2056522032,
    InputHash_Run=-465060815,
    InputHash_Settings=0,
    PO_Version=2)  # -> Number, UsedFallback, Metrics
ai_int = AIToInteger(
    Input=text2ai_4,
    Run=toggle_3,
    AIProvider="Default",
    InputBranchCount_Fallback=0,
    InputBranchCount_Input=1,
    InputBranchCount_Run=1,
    InputBranchCount_Settings=0,
    InputHash_Fallback=0,
    InputHash_Input=1539005869,
    InputHash_Run=-465060815,
    InputHash_Settings=0,
    PO_Version=2)  # -> Integer, UsedFallback, Metrics
ai_textlist = AIToTextList(
    Input=text2ai_5,
    Run=toggle_3,
    AIProvider="Default",
    InputBranchCount_Fallback=0,
    InputBranchCount_Input=1,
    InputBranchCount_Run=1,
    InputBranchCount_Settings=0,
    InputHash_Fallback=0,
    InputHash_Input=-1132486018,
    InputHash_Run=-465060815,
    InputHash_Settings=0,
    PO_Version=2)  # -> TextList, UsedFallback, Metrics
ai_numlist = AIToNumberList(
    Input=text2ai_6,
    Run=toggle_3,
    AIProvider="Default",
    InputBranchCount_Fallback=0,
    InputBranchCount_Input=1,
    InputBranchCount_Run=1,
    InputBranchCount_Settings=0,
    InputHash_Fallback=0,
    InputHash_Input=-817692865,
    InputHash_Run=-465060815,
    InputHash_Settings=0,
    PO_Version=2)  # -> NumberList, UsedFallback, Metrics
ai_intlist = AIToIntegerList(
    Input=text2ai_7,
    Run=toggle_3,
    AIProvider="Default",
    InputBranchCount_Fallback=0,
    InputBranchCount_Input=1,
    InputBranchCount_Run=1,
    InputBranchCount_Settings=0,
    InputHash_Fallback=0,
    InputHash_Input=1476719199,
    InputHash_Run=-465060815,
    InputHash_Settings=0,
    PO_Version=2)  # -> IntegerList, UsedFallback, Metrics
ai_boollist = AIToBooleanList(
    Input=text2ai_8,
    Run=toggle_3,
    AIProvider="Default",
    InputBranchCount_Fallback=0,
    InputBranchCount_Input=1,
    InputBranchCount_Run=1,
    InputBranchCount_Settings=0,
    InputHash_Fallback=0,
    InputHash_Input=-156122087,
    InputHash_Run=-465060815,
    InputHash_Settings=0,
    PO_Version=2)  # -> BooleanList, UsedFallback, Metrics
panel_4 = Panel("Reply with only the exact value(s) you received. For a JSON array or object echo it verbatim. No extra words.")
panel_5 = Panel("""red
green
blue""")
panel_6 = Panel("""1.5
2.5
3.5""")
panel_7 = Panel("""true
false
true""")
panel_8 = Panel("""10
20
30""")
num2ai = NumberToAI(Number="3.14159")
numlist2ai = NumberListToAI(NumberList=panel_6)
aiprompt_2 = AIPrompt(Prompt=panel_4)
bool2ai = BooleanToAI(Boolean=Toggle(True))
textlist2ai = TextListToAI(TextList=panel_5)
boollist2ai = BooleanListToAI(BooleanList=panel_7)
text2ai_9 = TextToAI()
textlist2ai_2 = TextListToAI(TextList="x")
json2ai = JSONToAI(JSON="{\"a\":1,\"b\":[2,3]}")
json2ai_2 = JSONToAI(JSON="{not valid json")
int2ai = IntegerToAI(Integer="7")
intlist2ai = IntegerListToAI(IntegerList=panel_8)
toggle_4 = BooleanToggle(True)
ai_text_3 = AIToText(
    Input=[num2ai, aiprompt_2],
    Run=toggle_4,
    AIProvider="Default",
    InputBranchCount_Input=1,
    InputBranchCount_Run=1,
    InputBranchCount_Settings=0,
    InputHash_Input=-448711155,
    InputHash_Run=-465060815,
    InputHash_Settings=0,
    PO_Version=2)  # -> Text, Metrics
ai_text_4 = AIToText(
    Input=[int2ai, aiprompt_2],
    Run=toggle_4,
    AIProvider="Default",
    InputBranchCount_Input=1,
    InputBranchCount_Run=1,
    InputBranchCount_Settings=0,
    InputHash_Input=1458380738,
    InputHash_Run=-465060815,
    InputHash_Settings=0,
    PO_Version=2)  # -> Text, Metrics
ai_text_5 = AIToText(
    Input=[bool2ai, aiprompt_2],
    Run=toggle_4,
    AIProvider="Default",
    InputBranchCount_Input=1,
    InputBranchCount_Run=1,
    InputBranchCount_Settings=0,
    InputHash_Input=2114980954,
    InputHash_Run=-465060815,
    InputHash_Settings=0,
    PO_Version=2)  # -> Text, Metrics
ai_text_6 = AIToText(
    Input=[textlist2ai, aiprompt_2],
    Run=toggle_4,
    AIProvider="Default",
    InputBranchCount_Input=1,
    InputBranchCount_Run=1,
    InputBranchCount_Settings=0,
    InputHash_Input=1091730275,
    InputHash_Run=-465060815,
    InputHash_Settings=0,
    PO_Version=2)  # -> Text, Metrics
ai_text_7 = AIToText(
    Input=[numlist2ai, aiprompt_2],
    Run=toggle_4,
    AIProvider="Default",
    InputBranchCount_Input=1,
    InputBranchCount_Run=1,
    InputBranchCount_Settings=0,
    InputHash_Input=-1013236904,
    InputHash_Run=-465060815,
    InputHash_Settings=0,
    PO_Version=2)  # -> Text, Metrics
ai_text_8 = AIToText(
    Input=[boollist2ai, aiprompt_2],
    Run=toggle_4,
    AIProvider="Default",
    InputBranchCount_Input=1,
    InputBranchCount_Run=1,
    InputBranchCount_Settings=0,
    InputHash_Input=1647674614,
    InputHash_Run=-465060815,
    InputHash_Settings=0,
    PO_Version=2)  # -> Text, Metrics
ai_text_9 = AIToText(
    Input=[json2ai, aiprompt_2],
    Run=toggle_4,
    AIProvider="Default",
    InputBranchCount_Input=1,
    InputBranchCount_Run=1,
    InputBranchCount_Settings=0,
    InputHash_Input=-1602444569,
    InputHash_Run=-465060815,
    InputHash_Settings=0,
    PO_Version=2)  # -> Text, Metrics
ai_text_10 = AIToText(
    Input=[intlist2ai, aiprompt_2],
    Run=toggle_4,
    AIProvider="Default",
    InputBranchCount_Input=1,
    InputBranchCount_Run=1,
    InputBranchCount_Settings=0,
    InputHash_Input=1163837802,
    InputHash_Run=-465060815,
    InputHash_Settings=0,
    PO_Version=2)  # -> Text, Metrics
ai_text_11 = AIToText(
    Input=[textlist2ai_2, aiprompt_2],
    Run=toggle_4,
    AIProvider="Default",
    InputBranchCount_Input=1,
    InputBranchCount_Run=1,
    InputBranchCount_Settings=0,
    InputHash_Input=-720632078,
    InputHash_Run=-465060815,
    InputHash_Settings=0,
    PO_Version=2)  # -> Text, Metrics
textlist2ai_3 = TextListToAI(TextList=["alpha", "beta", "gamma"])
ai_text_12 = AIToText(
    Input=[textlist2ai_3, aiprompt_2],
    Run=toggle_4,
    AIProvider="Default",
    InputBranchCount_Input=1,
    InputBranchCount_Run=1,
    InputBranchCount_Settings=0,
    InputHash_Input=-965954456,
    InputHash_Run=-465060815,
    InputHash_Settings=0,
    PO_Version=2)  # -> Text, Metrics
panel_9 = Panel("C:\Users\Marc Roca\source\repos\architects-toolkit\SmartHopper-public\e2e-report\test-assets\sample.md")
panel_10 = Panel("C:\Users\Marc Roca\source\repos\architects-toolkit\SmartHopper-public\e2e-report\test-assets\does-not-exist.pdf")
file2ai = FileToAI(
    FilePath=panel_9,
    RemoveHeaders=True,
    ImageMode="skip",
    Run=toggle_4,
    AIProvider="Default",
    InputBranchCount_File_Path=1,
    InputBranchCount_Image_Mode=1,
    InputBranchCount_Remove_Headers=1,
    InputBranchCount_Run=1,
    InputBranchCount_Settings=0,
    InputHash_File_Path=919403561,
    InputHash_Image_Mode=1551564357,
    InputHash_Remove_Headers=-465060815,
    InputHash_Run=-465060815,
    InputHash_Settings=0,
    PO_Version=2)  # -> Input, Markdown, Format, Metrics
file2ai_2 = FileToAI(
    FilePath=panel_10,
    RemoveHeaders=True,
    ImageMode="skip",
    Run=toggle_4,
    AIProvider="Default",
    InputBranchCount_File_Path=1,
    InputBranchCount_Image_Mode=1,
    InputBranchCount_Remove_Headers=1,
    InputBranchCount_Run=1,
    InputBranchCount_Settings=0,
    InputHash_File_Path=1397734853,
    InputHash_Image_Mode=1551564357,
    InputHash_Remove_Headers=-465060815,
    InputHash_Run=-465060815,
    InputHash_Settings=0,
    PO_Version=2)  # -> Input, Markdown, Format, Metrics
web2ai = WebToAI(
    URL="https://example.com",
    ImageMode="link",
    Run=toggle_4,
    AIProvider="Default",
    InputBranchCount_Image_Mode=1,
    InputBranchCount_Run=1,
    InputBranchCount_Settings=0,
    InputBranchCount_URL=1,
    InputHash_Image_Mode=281707502,
    InputHash_Run=-465060815,
    InputHash_Settings=0,
    InputHash_URL=1923973460,
    PO_Version=2)  # -> Input, Markdown, Metrics
web2ai_2 = WebToAI(
    URL="not-a-valid-url",
    ImageMode="link",
    Run=toggle_4,
    AIProvider="Default",
    InputBranchCount_Image_Mode=1,
    InputBranchCount_Run=1,
    InputBranchCount_Settings=0,
    InputBranchCount_URL=1,
    InputHash_Image_Mode=281707502,
    InputHash_Run=-465060815,
    InputHash_Settings=0,
    InputHash_URL=1994726192,
    PO_Version=2)  # -> Input, Markdown, Metrics
settings_2 = Settings(Model="not-a-real-model-xyz", Batch=False)
settings_3 = Settings(MaxTokens="1", Batch=False)
settings_4 = Settings(Temperature="3.0", Batch=False)
text2ai_10 = TextToAI(Text="What is 2+2? Reply with the number only.")
text2ai_11 = TextToAI(Text="Count from 1 to 10 separated by commas.")
text2ai_12 = TextToAI(Text="What is 5+5? Number only.")
toggle_5 = BooleanToggle(True)
ai_text_13 = AIToText(
    Input=text2ai_10,
    Settings=settings_2,
    Run=toggle_5,
    AIProvider="Default",
    InputBranchCount_Input=1,
    InputBranchCount_Run=1,
    InputBranchCount_Settings=1,
    InputHash_Input=-1353855949,
    InputHash_Run=-465060815,
    InputHash_Settings=-1050955015,
    PO_Version=2)  # -> Text, Metrics
ai_text_14 = AIToText(
    Input=text2ai_11,
    Settings=settings_3,
    Run=toggle_5,
    AIProvider="Default",
    InputBranchCount_Input=1,
    InputBranchCount_Run=1,
    InputBranchCount_Settings=1,
    InputHash_Input=-529463927,
    InputHash_Run=-465060815,
    InputHash_Settings=-339343846,
    PO_Version=2)  # -> Text, Metrics
ai_text_15 = AIToText(
    Input=text2ai_12,
    Settings=settings_4,
    Run=toggle_5,
    AIProvider="Default",
    InputBranchCount_Input=1,
    InputBranchCount_Run=1,
    InputBranchCount_Settings=1,
    InputHash_Input=1053393842,
    InputHash_Run=-465060815,
    InputHash_Settings=826384726,
    PO_Version=2)  # -> Text, Metrics
panel_11 = Panel("C:\Users\Marc Roca\source\repos\architects-toolkit\SmartHopper-public\e2e-report\test-assets\test.png")
panel_12 = Panel("voxtral-mini-tts-latest")
panel_13 = Panel("Create a Grasshopper C# script component with inputs x and y (doubles) that outputs their sum z.")
toggle_6 = BooleanToggle(True)
panel_14 = Panel("C:\Users\Marc Roca\source\repos\architects-toolkit\SmartHopper-public\e2e-report\test-assets\tone.wav")
panel_15 = Panel("This audio contains a tone. Reply with the word AUDIO-OK if you received audio input, otherwise say NO-AUDIO.")
panel_16 = Panel("{\"modality_fallback\":\"configured_provider\"}")
settings_5 = Settings(Model="gpt-4o-mini-tts", Batch=False)
settings_6 = Settings(Batch=toggle_6)
settings_7 = Settings(Model="mistral-small-latest", Batch=False)
text2ai_13 = TextToAI(Text="Hello world. This is a SmartHopper text to speech test.")
text2ai_14 = TextToAI(Text="Reply with the word BATCH.")
settings_8 = Settings(Model="mistral-large-2411", Batch=False)
aiprompt_3 = AIPrompt(Prompt="Describe the dominant colors in this image in 5 words max.")
img2ai = ImageToAI(Image=panel_11)
model = Panel("gpt-4o-mini-tts")
model_2 = Panel("gpt-4o-mini-audio-preview")
aiprompt_4 = AIPrompt(Prompt=panel_15)
audio2ai = AudioToAI(FilePath=panel_14)
panel_18 = Panel("C:\Users\Marc Roca\source\repos\architects-toolkit\SmartHopper-public\e2e-report\test-assets\tts-out.mp3")
ai_text_16 = AIToText(
    Input=[audio2ai, aiprompt_4],
    Settings=model_2,
    Run=Toggle(True),
    AIProvider="OpenAI",
    InputBranchCount_Input=1,
    InputBranchCount_Run=1,
    InputBranchCount_Settings=1,
    InputHash_Input=-1929655667,
    InputHash_Run=-465060815,
    InputHash_Settings=399078293,
    PO_Version=2)  # -> Text, Metrics
ai_text_17 = AIToText(
    Input=[img2ai, aiprompt_3],
    Settings=settings_8,
    Run=Toggle(True),
    AIProvider="Default",
    InputBranchCount_Input=1,
    InputBranchCount_Run=1,
    InputBranchCount_Settings=1,
    InputHash_Input=-1059665354,
    InputHash_Run=-465060815,
    InputHash_Settings=-940271258,
    PO_Version=2)  # -> Text, Metrics
toggle_7 = BooleanToggle(True)
aiscriptgen = AIScriptGenerate(
    Prompt=panel_13,
    Run=toggle_7,
    AIProvider="Default",
    InputBranchCount_Prompt=1,
    InputBranchCount_Run=1,
    InputBranchCount_Settings=0,
    InputHash_Prompt=766999597,
    InputHash_Run=-465060815,
    InputHash_Settings=0,
    PO_Version=2)  # -> GhJSON, Summary, Information, Metrics
ai_speech = AIToSpeech(
    Input=text2ai_13,
    Voice="nova",
    Speed="1.0",
    Settings=settings_7,
    Run=toggle_7,
    AIProvider="MistralAI",
    InputBranchCount_Input=1,
    InputBranchCount_Run=1,
    InputBranchCount_Settings=1,
    InputBranchCount_Speed=1,
    InputBranchCount_Voice=1,
    InputHash_Input=1698062629,
    InputHash_Run=-465060815,
    InputHash_Settings=-2144518361,
    InputHash_Speed=-162292107,
    InputHash_Voice=-1669175464,
    PO_Version=2)  # -> Audio, Metrics
ai_text_18 = AIToText(
    Input=text2ai_14,
    Settings=settings_6,
    Run=[toggle_7, toggle_6],
    AIProvider="Default",
    BatchCustomIds="[\"sh-20261009072930-ai2textcomponent-00-4d1ac50b\"]",
    BatchProvider="MistralAI",
    BatchRequest="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",
    BatchSentinelIds="[\"sh-20261009072930-ai2textcomponent-00-4d1ac50b\"]",
    BatchSentinelTrees="{}",
    BatchSubmittedAt="2026-10-09T07:29:31.7288744+00:00",
    PO_Version=2)  # -> Text, Metrics
ai_speech_nofb = AIToSpeech(
    Input=text2ai_13,
    Voice="nova",
    Speed="1.0",
    Settings="mistral-small-latest",
    Run=Toggle(True),
    AIProvider="Default",
    InputBranchCount_Input=1,
    InputBranchCount_Run=1,
    InputBranchCount_Settings=1,
    InputBranchCount_Speed=1,
    InputBranchCount_Voice=1,
    InputHash_Input=1698062629,
    InputHash_Run=-465060815,
    InputHash_Settings=1668407660,
    InputHash_Speed=-162292107,
    InputHash_Voice=-1669175464,
    PO_Version=2)  # -> Audio, Metrics
audioview = AudioViewer(Audio=ai_speech.Audio, FilePath=panel_18, Play=False, Save=toggle_7)
sum_doubles = CSharpScript()  # -> z; inputs x: Double, y: Double
# ---------- sum_doubles: C# ----------
using System;
using System.Collections.Generic;
using Rhino.Geometry;

z = x + y;
# ---------- end sum_doubles ----------
panel_19 = Panel("Write a long essay about architecture history, at least 2000 words.")
settings_9 = Settings(Batch=False, Timeout="1")
text2ai_15 = TextToAI(Text=panel_19)
text2ai_16 = TextToAI(Text="Say OK")
ai_text_19 = AIToText(
    Input=text2ai_15,
    Settings=settings_9,
    Run=Toggle(True),
    AIProvider="Default",
    InputBranchCount_Input=1,
    InputBranchCount_Run=1,
    InputBranchCount_Settings=1,
    InputHash_Input=-219456547,
    InputHash_Run=-465060815,
    InputHash_Settings=-690348294,
    PO_Version=2)  # -> Text, Metrics
ai_text_gemini = AIToText(
    Input=text2ai_16,
    Run=Toggle(True),
    AIProvider="Gemini",
    InputBranchCount_Input=1,
    InputBranchCount_Run=1,
    InputBranchCount_Settings=0,
    InputHash_Input=-1192683271,
    InputHash_Run=-465060815,
    InputHash_Settings=0,
    PO_Version=2)  # -> Text, Metrics
